# Grasshopper definition building houses.gh (Grasshopper 0.9.76)

addmargin = Slider(0, range=0..10000)
pt = Point(<point referenced from the Rhino model>)
pt_2 = ConstructPoint(XCoordinate=0, YCoordinate=0, ZCoordinate=0)
pt_3 = Point(<point referenced from the Rhino model>)
cluster = Cluster(addmargin=addmargin, pt=pt_3)  # -> arearectangle_2, houserectangle_2
cluster_2 = Cluster_5(addmargin=addmargin, pt=pt)  # -> arearectangle_2, houserectangle_2
cluster_3 = Cluster_4(addmargin=addmargin, pt=pt_2)  # -> arearectangle_2, houserectangle_2
panel = Panel(" bungalow.plot")
panel_2 = Panel("family.plot")
panel_3 = Panel("mansion.plot")
cluster_4 = Cluster_3(baserectangle=cluster_3.houserectangle_2)
cluster_5 = Cluster_2(baserectangle=cluster.houserectangle_2)
cluster_6 = Cluster_6(baserectangle=cluster_2.houserectangle_2)
panel_4 = Panel("family.build")
panel_5 = Panel("bungalow.build")
panel_6 = Panel("mansion.build")
panel_7 = Panel(" area")
geo = Geometry(cluster_5)
geo_2 = Geometry(cluster_4)
geo_3 = Geometry(cluster_6)
preview = CustomPreview(Geometry=geo_2, Shader=ColourSwatch(SwatchColor=RGBA(255, 0, 0, 100)))
preview_2 = CustomPreview(Geometry=geo, Shader=ColourSwatch(SwatchColor=RGBA(38, 0, 255, 100)))
preview_3 = CustomPreview(Geometry=geo_3, Shader=ColourSwatch(SwatchColor=RGBA(25, 255, 0, 96)))
boundary = BoundarySurfaces(Edges=cluster_3.arearectangle_2)
boundary_2 = BoundarySurfaces(Edges=cluster_2.arearectangle_2)
boundary_3 = BoundarySurfaces(Edges=cluster.arearectangle_2)
geo_4 = Geometry(boundary_3)
geo_5 = Geometry(boundary)
geo_6 = Geometry(boundary_2)
geo_7 = Geometry([geo_5, geo_4, geo_6, geo_3, geo, geo_2])
preview_4 = CustomPreview(Geometry=geo_5, Shader=ColourSwatch(SwatchColor=RGBA(255, 0, 0, 60)))
preview_5 = CustomPreview(Geometry=geo_4, Shader=ColourSwatch(SwatchColor=RGBA(38, 0, 255, 60)))
preview_6 = CustomPreview(Geometry=geo_6, Shader=ColourSwatch(SwatchColor=RGBA(13, 255, 0, 60)))

# ==== cluster Cluster
area_basevalue = Slider(3000, range=0..10000)
house_length = Slider(10000, range=0..10000)
house_width = Slider(7500, range=0..10000)
addmargin = ClusterInput()
pt = ClusterInput()
pt_2 = Point(pt)
vec = VectorXYZ(XComponent=house_length, YComponent=house_width, ZComponent=0)  # -> Vector, Length
addition = Addition(A=area_basevalue, B=addmargin)
panel = Panel(" area")
move = Move(Geometry=pt_2, Motion=vec.Vector)  # -> Geometry, Transform
rec_2pt = Rectangle2Pt(Plane=PlaneXY(0, 0, 0), PointA=pt_2, PointB=move.Geometry, Radius=0)  # -> Rectangle, Length
offset = Offset(Curve=rec_2pt.Rectangle, Distance=addition, Plane=PlaneXY(0, 0, 0), Corners=1)
crv = Curve(rec_2pt.Rectangle)
crv_2 = Curve(offset)
houserectangle = Curve(crv)
arearectangle = Curve(crv_2)
arearectangle_2 = ClusterOutput(arearectangle)
houserectangle_2 = ClusterOutput(houserectangle)

# ==== cluster Cluster_2
roof_height = Slider(6000, range=0..10000)
roof_slope_factor = Slider(0.1, range=0..1)
box_height = Slider(3000, range=0..10000)
baserectangle = ClusterInput()
multiplication = Multiplication(A=roof_height, B=0.5)
baserectangle_2 = Curve(baserectangle)
Z = UnitZ(Factor=box_height)
Z_2 = UnitZ(Factor=multiplication)
move = Move(Geometry=baserectangle_2, Motion=Z)  # -> Geometry, Transform
extr = Extrude(Base=baserectangle_2, Direction=Z)
move_2 = Move(Geometry=move.Geometry, Motion=Z_2)  # -> Geometry, Transform
area = Area(Geometry=move_2.Geometry)  # -> Area, Centroid
geo = Geometry(graft(move.Geometry))
scale = Scale(Geometry=move.Geometry, Center=area.Centroid, Factor=roof_slope_factor)  # -> graft(Geometry), Transform
geo_2 = Geometry([geo, scale.Geometry])
boundary = BoundarySurfaces(Edges=baserectangle_2)
boundary_2 = BoundarySurfaces(Edges=scale.Geometry)
loft = Loft(Curves=geo_2, Options={Adjust=False, Closed=False, LoftEnds=0, LoftSimp=0, LoftType=0, Rebuild=10, Refit=0.01})
geo_3 = Geometry(flatten([extr, loft, boundary_2]))
geo_4 = ClusterOutput(geo_3)

# ==== cluster Cluster_3
roof_height = Slider(6000, range=0..10000)
box_height = Slider(6000, range=0..10000)
baserectangle = ClusterInput()
multiplication = Multiplication(A=roof_height, B=0.5)
baserectangle_2 = Curve(baserectangle)
Z = UnitZ(Factor=box_height)
Z_2 = UnitZ(Factor=multiplication)
move = Move(Geometry=baserectangle_2, Motion=Z)  # -> Geometry, Transform
extr = Extrude(Base=baserectangle_2, Direction=Z)
move_2 = Move(Geometry=move.Geometry, Motion=Z_2)  # -> Geometry, Transform
area = Area(Geometry=move_2.Geometry)  # -> Area, Centroid
pl = ConstructPlane(Origin=area.Centroid, XAxis=Vector(1, 0, 0), YAxis=Vector(0, 1, 0))
scale_nu = ScaleNU(Geometry=move_2.Geometry, Plane=pl, ScaleX=Slider(0.001, range=0..0.001), ScaleY=1, ScaleZ=1)  # -> Geometry, Transform
geo = Geometry(flatten([move.Geometry, scale_nu.Geometry]))
boundary = BoundarySurfaces(Edges=scale_nu.Geometry)
boundary_2 = BoundarySurfaces(Edges=baserectangle_2)
loft = Loft(Curves=geo, Options={Adjust=False, Closed=False, LoftEnds=0, LoftSimp=0, LoftType=0, Rebuild=10, Refit=0.01})
geo_2 = Geometry(flatten([extr, loft, boundary]))
geo_3 = ClusterOutput(geo_2)

# ==== cluster Cluster_4
area_basevalue = Slider(2000, range=0..10000)
house_length = Slider(8000, range=0..10000)
house_width = Slider(8000, range=0..10000)
addmargin = ClusterInput()
pt = ClusterInput()
pt_2 = Point(pt)
vec = VectorXYZ(XComponent=house_length, YComponent=house_width, ZComponent=0)  # -> Vector, Length
addition = Addition(A=area_basevalue, B=addmargin)
panel = Panel(" area")
move = Move(Geometry=pt_2, Motion=vec.Vector)  # -> Geometry, Transform
rec_2pt = Rectangle2Pt(Plane=PlaneXY(0, 0, 0), PointA=pt_2, PointB=move.Geometry, Radius=0)  # -> Rectangle, Length
offset = Offset(Curve=rec_2pt.Rectangle, Distance=addition, Plane=PlaneXY(0, 0, 0), Corners=1)
crv = Curve(rec_2pt.Rectangle)
crv_2 = Curve(offset)
houserectangle = Curve(crv)
arearectangle = Curve(crv_2)
arearectangle_2 = ClusterOutput(arearectangle)
houserectangle_2 = ClusterOutput(houserectangle)

# ==== cluster Cluster_5
area_basevalue = Slider(6000, range=0..10000)
house_length = Slider(11000, range=0..20000)
house_width = Slider(10500, range=0..20000)
addmargin = ClusterInput()
pt = ClusterInput()
pt_2 = Point(pt)
vec = VectorXYZ(XComponent=house_length, YComponent=house_width, ZComponent=0)  # -> Vector, Length
addition = Addition(A=area_basevalue, B=addmargin)
panel = Panel(" area")
move = Move(Geometry=pt_2, Motion=vec.Vector)  # -> Geometry, Transform
rec_2pt = Rectangle2Pt(Plane=PlaneXY(0, 0, 0), PointA=pt_2, PointB=move.Geometry, Radius=0)  # -> Rectangle, Length
offset = Offset(Curve=rec_2pt.Rectangle, Distance=addition, Plane=PlaneXY(0, 0, 0), Corners=1)
crv = Curve(rec_2pt.Rectangle)
crv_2 = Curve(offset)
houserectangle = Curve(crv)
arearectangle = Curve(crv_2)
arearectangle_2 = ClusterOutput(arearectangle)
houserectangle_2 = ClusterOutput(houserectangle)

# ==== cluster Cluster_6
baserectangle = ClusterInput()
baserectangle_2 = Curve(baserectangle)
explode = Explode(Curve=baserectangle_2, Recursive=True)  # -> Segments, Vertices
roof_height = Slider(2845, range=0..10000)
roof_slope_factor = Slider(0.1, range=0..1)
box_height = Slider(6000, range=0..10000)
item = ListItem(List=explode.Segments, Index=0, Wrap=True)
item_2 = ListItem(List=explode.Segments, Index=Slider(1, range=0..1), Wrap=True)
end = EndPoints(Curve=item_2)  # -> Start, End
line = Line(item)
multiplication = Multiplication(A=roof_height, B=0.5)
vec2pt = Vector2Pt(PointA=end.Start, PointB=end.End, Unitize=False)  # -> Vector, Length
divide = DivideCurve(Curve=line, Count=3, Kinks=False)  # -> Points, Tangents, Parameters
Z = UnitZ(Factor=box_height)
Z_2 = UnitZ(Factor=multiplication)
item_3 = ListItem(List=divide.Points, Index=1, Wrap=True)
amp = Amplitude(Vector=vec2pt.Vector, Amplitude=Slider(1355, range=0..10000))
item_4 = ListItem(List=divide.Points, Index=2, Wrap=True)
move = Move(Geometry=item_3, Motion=amp)  # -> Geometry, Transform
baserectangle_3 = Curve(baserectangle_2)
rec_2pt = Rectangle2Pt(Plane=PlaneXY(0, 0, 0), PointA=move.Geometry, PointB=item_4, Radius=0)  # -> Rectangle, Length
multiplication_2 = Multiplication(A=Slider(1795, range=0..10000), B=-1)
sdiff = SolidDifference(BrepsA=baserectangle_3, BrepsB=rec_2pt.Rectangle)
baserectangleedit = Curve(sdiff)
move_2 = Move(Geometry=baserectangleedit, Motion=Z)  # -> Geometry, Transform
extr = Extrude(Base=baserectangleedit, Direction=Z)
geo = Geometry(move_2.Geometry)
offset = Offset(Curve=geo, Distance=multiplication_2, Plane=PlaneXY(0, 0, 0), Corners=1)
move_3 = Move(Geometry=offset, Motion=Z_2)  # -> Geometry, Transform
geo_2 = Geometry(flatten([move_3.Geometry, geo]))
boundary = BoundarySurfaces(Edges=baserectangleedit)
loft = Loft(Curves=geo_2, Options={Adjust=False, Closed=False, LoftEnds=0, LoftSimp=0, LoftType=0, Rebuild=10, Refit=0.01})
boundary_2 = BoundarySurfaces(Edges=move_3.Geometry)
geo_3 = Geometry(flatten([extr, loft, boundary_2]))
geo_4 = ClusterOutput(geo_3)
