# Grasshopper definition code v3.gh (Grasshopper 0.9.76)

n_houses_per_column = Slider(3, range=1..21)
additional_meters = Slider(2, range=0..20)
n_houses_per_row = Slider(5, range=1..21)
pt = ConstructPoint(XCoordinate=0, YCoordinate=0, ZCoordinate=0)
num = Number(additional_meters)
multiplication = Multiplication(A=num, B="1000")
multiplication_2 = Multiplication(A=num, B="1000")
cluster = Cluster_4(pt=pt)  # -> arearectangle_2, houserectangle_2, house_length_2, house_width_2
panel = Panel("mansion.plot")
panel_2 = Panel("family.plot")
panel_3 = Panel(" bungalow.plot")
cluster_2 = Cluster(pt=pt)  # -> arearectangle_2, houserectangle_2, house_length_2, house_width_2
cluster_3 = Cluster_6(pt=pt)  # -> arearectangle_2, houserectangle_2, R, R_2
num_2 = Number(cluster_3.R_2)
num_3 = Number(cluster_3.R)
house_length_margin = Number(num_3)
house_width_margin = Number(num_2)
addition = Addition(A=house_length_margin, B=multiplication)
addition_2 = Addition(A=house_width_margin, B=multiplication_2)
addition_3 = Addition(A=num, B=1)

cluster_4 = Cluster_3(baserectangle=cluster_3.houserectangle_2)
cluster_5 = Cluster_2(baserectangle=cluster_2.houserectangle_2)
cluster_6 = Cluster_5(baserectangle=cluster.houserectangle_2)
panel_4 = Panel("family.build")
panel_5 = Panel("bungalow.build")
panel_6 = Panel("mansion.build")
geo = Geometry(cluster_4)
geo_2 = Geometry(cluster_5)
geo_3 = Geometry(cluster_6)
preview = CustomPreview(Geometry=geo, Shader=ColourSwatch(SwatchColor=RGBA(255, 0, 0, 100)))
preview_2 = CustomPreview(Geometry=geo_2, Shader=ColourSwatch(SwatchColor=RGBA(0, 255, 17, 100)))
preview_3 = CustomPreview(Geometry=geo_3, Shader=ColourSwatch(SwatchColor=RGBA(255, 208, 0, 96)))

series = Series(Start=0, Step="1000", Count=addition_3)
y_between_houses = Panel(addition)
x_between_houses = Panel(addition_2)
num_4 = Number(cluster_3.R_2)
num_5 = Number(cluster_3.R)
house_length_margin_2 = Number(num_5)
house_width_margin_2 = Number(num_4)
series_2 = Series(Start=0, Step=y_between_houses, Count=n_houses_per_row)
series_3 = Series(Start=0, Step=x_between_houses, Count=n_houses_per_column)
offset = Offset(Curve=cluster_3.arearectangle_2, Distance=series, Plane=PlaneXY(0, 0, 0), Corners=1)  # -> flatten(Curve)
lng = ListLength(List=offset)
Y = UnitY(Factor=series_2)
X = UnitX(Factor=series_3)
# Bake and assign gap: keeps code fast
geo_4 = Geometry(geo)
geo_5 = Geometry(cluster_5)
geo_6 = Geometry(cluster_6)
subtraction = Subtraction(A=lng, B=1)
addition_4 = Addition(A=Y, B=graft(X))
crv = Curve(offset)
ringindicators = Curve(crv)
family = Geometry(geo_4)
bungalow = Geometry(geo_5)
mansion = Geometry(geo_6)
item = ListItem(List=offset, Index=subtraction, Wrap=True)
familygeo = Geometry(family)
bungalow_2 = Geometry(bungalow)
mansion_2 = Geometry(mansion)
boundary = BoundarySurfaces(Edges=item)
vec = Vector(addition_4)
vectorseries = Vector(vec)
geo_7 = Geometry(boundary)
boundary_2 = BoundarySurfaces()
boundary_3 = BoundarySurfaces()
geo_8 = Geometry(boundary_3)
geo_9 = Geometry(boundary_2)
preview_4 = CustomPreview(Geometry=geo_7, Shader=ColourSwatch(SwatchColor=RGBA(255, 0, 0, 60)))
preview_5 = CustomPreview(Geometry=geo_8, Shader=ColourSwatch(SwatchColor=RGBA(0, 255, 17, 60)))
preview_6 = CustomPreview(Geometry=geo_9, Shader=ColourSwatch(SwatchColor=RGBA(255, 234, 0, 60)))
geo_10 = Geometry(boundary)
crv_2 = Curve(ringindicators)
family_2 = Geometry(familygeo)
vec_2 = Vector(vectorseries)
vectorseries_2 = Vector(vec_2)
ringindicators_2 = Curve(crv_2)
baseplate = Geometry(geo_10)
familygeo_2 = Geometry(family_2)
move = Move(Geometry=[familygeo_2, baseplate, ringindicators_2], Motion=graft(vectorseries_2))  # -> Geometry, Transform
geo_11 = Geometry(move.Geometry)

# ==== cluster Cluster
area_basevalue = Slider(3000, range=0..10000)
house_length = Slider(10000, range=0..10000)
house_width = Slider(7500, range=0..10000)
house_length_2 = ClusterOutput(house_length)
house_width_2 = ClusterOutput(house_width)
pt = ClusterInput()
pt_2 = Point(pt)
vec = VectorXYZ(XComponent=house_length, YComponent=house_width, ZComponent=0)  # -> Vector, Length
panel = Panel(" area")
move = Move(Geometry=pt_2, Motion=vec.Vector)  # -> Geometry, Transform
rec_2pt = Rectangle2Pt(Plane=PlaneXY(0, 0, 0), PointA=pt_2, PointB=move.Geometry, Radius=0)  # -> Rectangle, Length
offset = Offset(Curve=rec_2pt.Rectangle, Distance=area_basevalue, Plane=PlaneXY(0, 0, 0), Corners=1)
crv = Curve(rec_2pt.Rectangle)
crv_2 = Curve(offset)
houserectangle = Curve(crv)
arearectangle = Curve(crv_2)
arearectangle_2 = ClusterOutput(arearectangle)
houserectangle_2 = ClusterOutput(houserectangle)

# ==== cluster Cluster_2
roof_height = Slider(6000, range=0..10000)
roof_slope_factor = Slider(0.1, range=0..1)
box_height = Slider(3000, range=0..10000)
baserectangle = ClusterInput()
multiplication = Multiplication(A=roof_height, B=0.5)
baserectangle_2 = Curve(baserectangle)
Z = UnitZ(Factor=box_height)
Z_2 = UnitZ(Factor=multiplication)
move = Move(Geometry=baserectangle_2, Motion=Z)  # -> Geometry, Transform
extr = Extrude(Base=baserectangle_2, Direction=Z)
move_2 = Move(Geometry=move.Geometry, Motion=Z_2)  # -> Geometry, Transform
area = Area(Geometry=move_2.Geometry)  # -> Area, Centroid
geo = Geometry(graft(move.Geometry))
scale = Scale(Geometry=move.Geometry, Center=area.Centroid, Factor=roof_slope_factor)  # -> graft(Geometry), Transform
geo_2 = Geometry([geo, scale.Geometry])
boundary = BoundarySurfaces(Edges=baserectangle_2)
boundary_2 = BoundarySurfaces(Edges=scale.Geometry)
loft = Loft(Curves=geo_2, Options={Adjust=False, Closed=False, LoftEnds=0, LoftSimp=0, LoftType=0, Rebuild=10, Refit=0.01})
join = BrepJoin(Breps=flatten([extr, loft, boundary_2]))  # -> Breps, Closed
geo_3 = Geometry(flatten(join.Breps))
geo_4 = ClusterOutput(geo_3)

# ==== cluster Cluster_3
roof_height = Slider(6000, range=0..10000)
box_height = Slider(6000, range=0..10000)
baserectangle = ClusterInput()
multiplication = Multiplication(A=roof_height, B=0.5)
baserectangle_2 = Curve(baserectangle)
Z = UnitZ(Factor=box_height)
Z_2 = UnitZ(Factor=multiplication)
move = Move(Geometry=baserectangle_2, Motion=Z)  # -> Geometry, Transform
extr = Extrude(Base=baserectangle_2, Direction=Z)
move_2 = Move(Geometry=move.Geometry, Motion=Z_2)  # -> Geometry, Transform
area = Area(Geometry=move_2.Geometry)  # -> Area, Centroid
pl = ConstructPlane(Origin=area.Centroid, XAxis=Vector(1, 0, 0), YAxis=Vector(0, 1, 0))
scale_nu = ScaleNU(Geometry=move_2.Geometry, Plane=pl, ScaleX=Slider(0.001, range=0..0.001), ScaleY=1, ScaleZ=1)  # -> Geometry, Transform
geo = Geometry(flatten([move.Geometry, scale_nu.Geometry]))
boundary = BoundarySurfaces(Edges=scale_nu.Geometry)
boundary_2 = BoundarySurfaces(Edges=baserectangle_2)
loft = Loft(Curves=geo, Options={Adjust=False, Closed=False, LoftEnds=0, LoftSimp=0, LoftType=0, Rebuild=10, Refit=0.01})
join = BrepJoin(Breps=[extr, loft, boundary])  # -> Breps, Closed
geo_2 = Geometry(join.Breps)
geo_3 = ClusterOutput(geo_2)

# ==== cluster Cluster_4
area_basevalue = Slider(6000, range=0..10000)
house_length = Slider(11000, range=0..20000)
house_width = Slider(10500, range=0..20000)
house_length_2 = ClusterOutput(house_length)
house_width_2 = ClusterOutput(house_width)
pt = ClusterInput()
pt_2 = Point(pt)
vec = VectorXYZ(XComponent=house_length, YComponent=house_width, ZComponent=0)  # -> Vector, Length
panel = Panel(" area")
move = Move(Geometry=pt_2, Motion=vec.Vector)  # -> Geometry, Transform
rec_2pt = Rectangle2Pt(Plane=PlaneXY(0, 0, 0), PointA=pt_2, PointB=move.Geometry, Radius=0)  # -> Rectangle, Length
offset = Offset(Curve=rec_2pt.Rectangle, Distance=area_basevalue, Plane=PlaneXY(0, 0, 0), Corners=1)
crv = Curve(rec_2pt.Rectangle)
crv_2 = Curve(offset)
houserectangle = Curve(crv)
arearectangle = Curve(crv_2)
arearectangle_2 = ClusterOutput(arearectangle)
houserectangle_2 = ClusterOutput(houserectangle)

# ==== cluster Cluster_5
baserectangle = ClusterInput()
baserectangle_2 = Curve(baserectangle)
explode = Explode(Curve=baserectangle_2, Recursive=True)  # -> Segments, Vertices
roof_height = Slider(2845, range=0..10000)
roof_slope_factor = Slider(0.1, range=0..1)
box_height = Slider(6000, range=0..10000)
item = ListItem(List=explode.Segments, Index=0, Wrap=True)
item_2 = ListItem(List=explode.Segments, Index=Slider(1, range=0..1), Wrap=True)
end = EndPoints(Curve=item_2)  # -> Start, End
line = Line(item)
multiplication = Multiplication(A=roof_height, B=0.5)
vec2pt = Vector2Pt(PointA=end.Start, PointB=end.End, Unitize=False)  # -> Vector, Length
divide = DivideCurve(Curve=line, Count=3, Kinks=False)  # -> Points, Tangents, Parameters
Z = UnitZ(Factor=box_height)
Z_2 = UnitZ(Factor=multiplication)
item_3 = ListItem(List=divide.Points, Index=1, Wrap=True)
amp = Amplitude(Vector=vec2pt.Vector, Amplitude=Slider(1355, range=0..10000))
item_4 = ListItem(List=divide.Points, Index=2, Wrap=True)
move = Move(Geometry=item_3, Motion=amp)  # -> Geometry, Transform
baserectangle_3 = Curve(baserectangle_2)
rec_2pt = Rectangle2Pt(Plane=PlaneXY(0, 0, 0), PointA=move.Geometry, PointB=item_4, Radius=0)  # -> Rectangle, Length
multiplication_2 = Multiplication(A=Slider(1795, range=0..10000), B=-1)
sdiff = SolidDifference(BrepsA=baserectangle_3, BrepsB=rec_2pt.Rectangle)
baserectangleedit = Curve(sdiff)
move_2 = Move(Geometry=baserectangleedit, Motion=Z)  # -> Geometry, Transform
extr = Extrude(Base=baserectangleedit, Direction=Z)
geo = Geometry(move_2.Geometry)
offset = Offset(Curve=geo, Distance=multiplication_2, Plane=PlaneXY(0, 0, 0), Corners=1)
move_3 = Move(Geometry=offset, Motion=Z_2)  # -> Geometry, Transform
geo_2 = Geometry(flatten([move_3.Geometry, geo]))
boundary = BoundarySurfaces(Edges=baserectangleedit)
loft = Loft(Curves=geo_2, Options={Adjust=False, Closed=False, LoftEnds=0, LoftSimp=0, LoftType=0, Rebuild=10, Refit=0.01})
boundary_2 = BoundarySurfaces(Edges=move_3.Geometry)
join = BrepJoin(Breps=flatten([extr, loft, boundary_2]))  # -> Breps, Closed
geo_3 = Geometry(flatten(join.Breps))
geo_4 = ClusterOutput(geo_3)

# ==== cluster Cluster_6
area_basevalue = Slider(2000, range=0..10000)
house_length = Slider(8000, range=0..10000)
house_width = Slider(8000, range=0..10000)
addition = Addition(A=house_length, B=area_basevalue)
addition_2 = Addition(A=house_width, B=area_basevalue)
pt = ClusterInput()
pt_2 = Point(pt)
vec = VectorXYZ(XComponent=house_length, YComponent=house_width, ZComponent=0)  # -> Vector, Length
R = ClusterOutput(addition)
R_2 = ClusterOutput(addition_2)
panel = Panel(" area")
move = Move(Geometry=pt_2, Motion=vec.Vector)  # -> Geometry, Transform
rec_2pt = Rectangle2Pt(Plane=PlaneXY(0, 0, 0), PointA=pt_2, PointB=move.Geometry, Radius=0)  # -> Rectangle, Length
offset = Offset(Curve=rec_2pt.Rectangle, Distance=area_basevalue, Plane=PlaneXY(0, 0, 0), Corners=1)
crv = Curve(rec_2pt.Rectangle)
crv_2 = Curve(offset)
houserectangle = Curve(crv)
arearectangle = Curve(crv_2)
arearectangle_2 = ClusterOutput(arearectangle)
houserectangle_2 = ClusterOutput(houserectangle)
